# Grasshopper definition facade_panelizer.gh (Grasshopper 1.0.8)

U = Slider(3, range=1..10)
V = Slider(2, range=1..10)
py3 = Python3Script(Prefix="A", U=U, V=V)  # -> out, Result, Errors
# ---------- py3: Python ----------
import os
import sys
import traceback

try:
    repo = os.getenv("GH_PARAMETRIC_TOOLKIT")
    if repo and repo not in sys.path:
        sys.path.insert(0, repo)

    from shared.loader import ensure_repo_on_syspath, run_tool
    ensure_repo_on_syspath()

    def main():
        from tools.facade_panelizer.src.panelizer import generate_panel_ids

        u = int(U)
        v = int(V)
        prefix = Prefix or "P"

        return generate_panel_ids(u, v, prefix)

    Result, Errors = run_tool(main)

except Exception:
    Errors = [traceback.format_exc()]
# ---------- end py3 ----------
panel = Panel(py3.Result)
panel_2 = Panel(py3.Errors)
